# Grasshopper definition GeoOpt_kmeans_01.gh (Grasshopper 1.0.7)
# plug-ins: Hops

concat = Concatenate(FragmentA="http://127.0.0.1:5000", FragmentB="/kmeans_simple")
hops = Hops(
    _Path=concat,
    NumberOfClusters=Slider(4, range=0..10),
    CacheResultsInMemory=False,
    CacheSolveResults=False,
    RemoteDefinitionLocation="http://127.0.0.1:5000/kmeans_simple",
    RemoteSolveVersion=(0, 1, 0),
    ShowInput_Enabled=False,
    ShowInput_Path=True,
    SynchronousSolve=True)  # -> Points, Clusters
bnd = Bounds(Numbers=hops.Clusters)
gradient = Gradient(
    LowerLimit=0,
    UpperLimit=bnd,
    Parameter=hops.Clusters,
    stops=[0: RGB(0, 128, 0), 0.502: RGB(255, 255, 0), 1: RGB(255, 0, 0)])
preview = CustomPreview(Geometry=hops.Points, Material=gradient)
