# Grasshopper definition GeoOpt_kmeans.gh (Grasshopper 1.0.7)
# plug-ins: Hops

subd = SubD(<subd referenced from the Rhino model>)
meshsubd = MeshFromSubD(SubD=subd, Density=Slider(0, range=0..10))

geo = Geometry(<brep referenced from the Rhino model>)
mesh_uv = MeshSurface(Surface=geo, UCount=5, VCount=5, Overhang=True, Equalize=False)

# ----
# MaCAD21
# GeoOpt seminar
# David A. Leon and Dai Kandil
# The most important thing is identifying
# the most important featuers(vectors) to
# encode into a meaningful clustering
number_slider = Slider(0, range=0..1)
filter = StreamFilter(Gate=number_slider, Stream0=meshsubd, Stream1=mesh_uv)
# K-Means clustering
mesh = Mesh(filter)

# ---- group: change this features
demesh = DeconstructMesh(Mesh=mesh)  # -> Vertices, Faces, Colours, Normals
item = ListItem(List=demesh.Vertices, Index=0, Wrap=True)  # -> Item, Item1, Item2, Item3
ln = Line(StartPoint=item.Item, EndPoint=item.Item3)
ln_2 = Line(StartPoint=item.Item1, EndPoint=item.Item2)
len = Length(Curve=ln_2)
len_2 = Length(Curve=ln)
llx = LineLine(Line1=ln, Line2=ln_2)  # -> ParamA, ParamB, PointA, PointB
angle = Angle(VectorA=ln, VectorB=ln_2)  # -> Angle, Reflex

# ----
explodemesh = GhPythonScript(m=mesh)  # -> out, a; inputs m: Mesh
# ---------- explodemesh: Python ----------
import Rhino.Geometry as rg

ghenv.Component.Message = "explode mesh"

exploded = []

for i in range(m.Faces.Count):
    m_copy = m.Duplicate()
    face = m_copy.Faces.ExtractFaces([i])
    exploded.append(face)
    
a = exploded
# ---------- end explodemesh ----------

# ---- group: define features to cluster
# Planarity feature encoding?
demesh_2 = DeconstructMesh(Mesh=explodemesh.a)  # -> Vertices, Faces, Colours, Normals
area = Area(Geometry=explodemesh.a)  # -> Area, Centroid
avr = Average(Input=demesh_2.Vertices)  # -> flatten(ArithmeticMean)
dist = Distance(PointA=avr, PointB=area.Centroid)

# Encoding the features to use for clustering
medges = MeshEdges(Mesh=explodemesh.a)  # -> NakedEdges, InteriorEdges, NonManifoldEdges
area_2 = Area(Geometry=explodemesh.a)  # -> Area, Centroid
join = JoinCurves(Curves=[medges.NakedEdges, medges.InteriorEdges], Preserve=False)
len_3 = Length(Curve=join)  # -> flatten(Length)

# ----
pop3d = Populate3D(
    Region={Plane=PlaneXY(0, 0, 0), X=Domain(0, 10), Y=Domain(0, 10), Z=Domain(0, 2)},
    Count=Slider(661, range=0..1000),
    Seed=1)

lng = ListLength(List=pop3d)
random = Random(Range="0 to 10", Number=lng, Seed=2)

entwine = Entwine(Branch00=len_2, Branch01=len, Branch02=llx.ParamA, Branch03=llx.ParamB, Branch04=angle.Angle, FlattenInputs=True)
entwine_2 = Entwine(Branch00=len_3, Branch01=area_2.Area, Branch02=dist, FlattenInputs=True)

# ----
# Encoding the features to use for clustering
pdecon = Deconstruct(Point=pop3d)  # -> XComponent, YComponent, ZComponent
entwine_3 = Entwine(Branch00=pdecon.XComponent, Branch01=pdecon.YComponent, Branch02=pdecon.ZComponent, Branch03=random, FlattenInputs=True)

clean = CleanTree(RemoveNulls=True, RemoveInvalid=True, RemoveEmpty=True, Tree=entwine_2)
clean_2 = CleanTree(RemoveNulls=True, RemoveInvalid=True, RemoveEmpty=True, Tree=entwine)
python = GhPythonScript(x=clean)  # -> out, a; inputs x: tree
# ---------- python: Python ----------
import Rhino.Geometry as rg
import ghpythonlib.treehelpers as th

def transpose(l):
    return map(list, zip(*l))
    


vec = th.tree_to_list(x)
features = len(vec)
dimensions = len(vec[0])

tvec = transpose(vec)

str_vecs = []
for v in tvec:
    empty = "[" 
    for i in range(len(v)):
        empty += str(v[i])
        if i != len(v)-1: empty += ","
        
    empty += "]"
    str_vecs.append(empty)
a = str_vecs
# ---------- end python ----------
python_2 = GhPythonScript(x=entwine_3)  # -> out, a; inputs x: tree; same code as python

# ----
# Similar to a dataframe with index, feature1,
#  feature2, feature 3 etc
panel = Panel(python.a)

# ----
# Similar to a dataframe with index, feature1,
#  feature2, feature 3 etc
panel_2 = Panel(python_2.a)
number_slider_2 = Slider(6, range=0..10)
number_slider_3 = Slider(7, range=0..10)

# ---- group: KMEANS
hops = Hops(
    _Path="http://127.0.0.1:5000/kmeans",
    Vectors=python.a,
    NumberOfClusters=number_slider_2,
    CacheResultsInMemory=True,
    CacheSolveResults=True,
    RemoteDefinitionLocation="http://127.0.0.1:5000/kmeans",
    RemoteSolveVersion=(0, 1, 0),
    ShowInput_Enabled=False,
    ShowInput_Path=True,
    SynchronousSolve=True)

# ----
hops_2 = Hops(
    _Path="http://127.0.0.1:5000/kmeans",
    Vectors=python_2.a,
    NumberOfClusters=number_slider_3,
    CacheResultsInMemory=True,
    CacheSolveResults=True,
    RemoteDefinitionLocation="http://127.0.0.1:5000/kmeans",
    RemoteSolveVersion=(0, 1, 0),
    ShowInput_Enabled=False,
    ShowInput_Path=True,
    SynchronousSolve=True)
python_3 = GhPythonScript(items=explodemesh.a, C=hops, k=number_slider_2)  # -> out, a; inputs items: list, C: list of Int32, k: Int32
# ---------- python_3: Python ----------
import Rhino.Geometry as rg
import ghpythonlib.treehelpers as th

clusters = [[] for i in range(k)]

for i in range(len(items)):
    clusters[C[i]].append(items[i])

a = th.list_to_tree(clusters)
# ---------- end python_3 ----------
python_4 = GhPythonScript(items=pop3d, C=hops_2, k=number_slider_3)  # -> out, a; inputs items: list, C: list of Int32, k: Int32; same code as python_3
tstat = TreeStatistics(Tree=python_3.a)  # -> Paths, Length, Count
series = Series(Start=0, Step=1, Count=tstat.Count)
tstat_2 = TreeStatistics(Tree=python_4.a)  # -> Paths, Length, Count
series_2 = Series(Start=0, Step=1, Count=tstat_2.Count)
gradient = Gradient(
    LowerLimit=0,
    UpperLimit=tstat.Count,
    Parameter=series,
    stops=[0: RGB(243, 57, 0), 0.1: RGB(236, 27, 60), 0.2: RGB(210, 0, 118), 0.3: RGB(103, 0, 120), 0.4: RGB(39, 72, 161), 0.5: RGB(1, 192, 229), 0.6: RGB(18, 178, 90), 0.7: RGB(79, 186, 8), 0.8: RGB(220, 237, 32), 0.9: RGB(247, 159, 20), 1: RGB(243, 57, 0)])
gradient_2 = Gradient(
    LowerLimit=0,
    UpperLimit=tstat_2.Count,
    Parameter=series_2,
    stops=[0: RGB(243, 57, 0), 0.1: RGB(236, 27, 60), 0.2: RGB(210, 0, 118), 0.3: RGB(103, 0, 120), 0.4: RGB(39, 72, 161), 0.5: RGB(1, 192, 229), 0.6: RGB(18, 178, 90), 0.7: RGB(79, 186, 8), 0.8: RGB(220, 237, 32), 0.9: RGB(247, 159, 20), 1: RGB(243, 57, 0)])
preview = CustomPreview(Geometry=python_3.a, Material=graft(gradient))
preview_2 = CustomPreview(Geometry=python_4.a, Material=graft(gradient_2))
